# Grasshopper definition Group05_CAT_Studio_Copilot.gh (Grasshopper 1.0.8)
# plug-ins: RhinoCodePluginGH, Heteroptera, MeshEdit Components, Human, Kangaroo2 Components, Wombat, ggRhinoIFC, Javid

courtyard_generation = Trigger(
    Interval=10000,
    TimerInterval=10000,
    Target=[area_5, coordinates_width_length, geometry_data, tree_data, graph_data, query_data, screenshot, ghpython_script])  # disabled
utci_analysis = Trigger(Interval=-1000, TimerInterval=1000, Target=python_3_script_7)
sending_utci_to_ui = Trigger(Interval=1000, TimerInterval=1000, Target=[python_3_script_10, python_3_script_11])  # disabled

# ---- group: path to your ifc file
file_path = FilePath("F:\70_70_0_10_3000_5000_True_0.3_36_25_50_60 (1).ifc")

# ---- group: comunities file path
file_path_2 = FilePath("F:\communities (1).json")

# ----
geometry_data = Python3Script()  # -> out, a, spaces_list, spaces_values, links_sources, links_targets, weights_names, weights_values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
# ---------- geometry_data: Python ----------
# requirements: requests
import requests
from ghpythonlib.treehelpers import list_to_tree

# Define the URL for the Flask server endpoint
url = 'http://127.0.0.1:5000/geometry_data'

# Initialize the output variable
geometry_data = 'Has not been generated yet'

# Check if the script should run

try:
    # Send a GET request to the Flask server to fetch the data
    response = requests.get(url)

    # Check the response status code
    if response.status_code == 200:
        data = response.json()
        geometry_data = data.get("geometry_data", {})
        print(f"Received geometry_data: {geometry_data}")
    else:
        out = f"Failed to connect: {response.status_code}"
except Exception as e:
    out = f"Error: {e}"

# Assign the output to a variable for Grasshopper
a = geometry_data

# Initialize default empty lists
spaces_list = []
spaces_values = []
links_sources = []
links_targets = []
weights_names = []
weights_values = []
anchors_names = []
anchors_values = []
pos_names = []
pos_coords = []
cardinal_names = []
cardinal_dirs = []
position_names = []
position_num = []

# Only extract data if geometry_data is a dictionary and contains the expected keys
if isinstance(geometry_data, dict) and geometry_data != 'Has not been generated yet':
    try:
        # Extract spaces data
        if 'spaces' in geometry_data:
            spaces_dict = geometry_data['spaces']
            if isinstance(spaces_dict, dict):
                spaces_list = list(spaces_dict.keys())
                spaces_values = list(spaces_dict.values())
        
        # Extract links data
        if 'links' in geometry_data:
            links_dict = geometry_data['links']
            if isinstance(links_dict, dict):
                links_sources = list(links_dict.keys())
                links_targets = list(links_dict.values())
        
        # Extract weights data
        if 'weights' in geometry_data:
            weights_dict = geometry_data['weights']
            if isinstance(weights_dict, dict):
                weights_names = list(weights_dict.keys())
                weights_values = list(weights_dict.values())
        
        # Extract anchors data
        if 'anchors' in geometry_data:
            anchors_dict = geometry_data['anchors']
            if isinstance(anchors_dict, dict):
                anchors_names = list(anchors_dict.keys())
                anchors_values = list(anchors_dict.values())
        
        # Extract pos data with coordinate conversion
            if 'pos' in geometry_data:
                pos_dict = geometry_data['pos']
                if isinstance(pos_dict, dict):
                    pos_names = list(pos_dict.keys())
                    pos_coords = []

                    for name, coord in pos_dict.items():
                        try:
                            # Force convert to string first, then parse
                            coord_str = str(coord)
                            coord_str = coord_str.replace('[', '').replace(']', '').replace('(', '').replace(')', '')
                            parts = coord_str.split(',')
                            if len(parts) >= 2:
                                x = float(parts[0].strip())
                                y = float(parts[1].strip())
                                pos_coords.append([x, y])
                            else:
                                pos_coords.append([0.0, 0.0])
                        except Exception as e:
                            print(f"Error converting coordinate for {name}: {coord} - {e}")
                            pos_coords.append([0.0, 0.0])

                    # Convert to Grasshopper-friendly DataTree
                    pos_coords = list_to_tree(pos_coords)

            # Extract cardinal_directions
            if 'cardinal_directions' in geometry_data:
                cardinal_directions = geometry_data['cardinal_directions']  # ✅ THIS LINE IS REQUIRED
                for entry in cardinal_directions:
                    if ':' in entry:
                        name, direction = entry.split(':')
                        cardinal_names.append(name.strip())
                        cardinal_dirs.append(direction.strip())

            # Extract positions
            if 'positions' in geometry_data:
                positions = geometry_data['positions']
                for entry in positions:
                    if ':' in entry:
                        name, number = entry.split(':')
                        position_names.append(name.strip())
                        position_num.append(number.strip())


        print(f"Successfully extracted data:")
        print(f"Spaces: {len(spaces_list)} items")
        print(f"Links: {len(links_sources)} items")
        print(f"Weights: {len(weights_names)} items")
        print(f"Anchors: {len(anchors_names)} items")
        print(f"Positions: {len(pos_names)} items")
        
    except Exception as e:
        print(f"Error extracting data: {e}")
        # Keep the default empty lists if extraction fails
else:
    print("No valid geometry data available yet")


spaces_list = spaces_list
spaces_values = spaces_values
links_sources = links_sources
links_targets = links_targets
weights_names = weights_names
weights_values = weights_values
anchors_names = anchors_names
anchors_values = anchors_values
pos_names = pos_names
pos_coords = pos_coords
cardinal_names = cardinal_names
cardinal_dirs = cardinal_dirs
position_names = position_names
position_num = position_num
# ---------- end geometry_data ----------
ghpython_script = GhPythonScript()  # -> bitmap
# ---------- ghpython_script: Python ----------
__author__ = "Serjoscha Duering"
__version__ = "2024.02.24"

import rhinoscriptsyntax as rs
import Grasshopper.DataTree as tree
import Grasshopper.Kernel.Data.GH_Path as ghpath


import Rhino
import scriptcontext as sc
import System.Drawing as sd
import os
import time

def capture_viewport_to_bitmap():
    tm = str(time.time())
    # Define the path where the screenshot will be saved temporarily
    tmp_filename = "temp_vp"+tm + ".png"
    temp_path = os.path.join(os.environ['TEMP'], tmp_filename)
    
    # Get the active Rhino document's active view
    view = sc.doc.Views.ActiveView
    
    # Ensure there's an active view to work with
    if not view:
        print("No active view found.")
        return None

    # Set the view to rendered mode (if not already)
    view.ActiveViewport.DisplayMode = Rhino.Display.DisplayModeDescription.FindByName("Rendered")
    sc.doc.Views.Redraw()

    # Capture the viewport to the file
    size = view.Size
    view.CaptureToBitmap(sd.Size(size.Width, size.Height)).Save(temp_path)
    
    # Load the image from the file into a System.Drawing.Bitmap
    bitmap = sd.Bitmap(temp_path)
    
    # Optionally, clean up the temporary file
    #os.remove(temp_path)
    
    return bitmap

# Example usage
bitmap = capture_viewport_to_bitmap()
if bitmap:
    print("Viewport captured as bitmap.")
    # Here you can use the bitmap, e.g., display it in a form, save to a file, etc.
else:
    print("Failed to capture viewport.")
# ---------- end ghpython_script ----------
tree_data = Python3Script()  # -> out, a, tree_ids, tree_positions, pwr_names, pwr_values
# ---------- tree_data: Python ----------
# requirements: requests
import requests

# Define the URL for the Flask server endpoint
url = 'http://127.0.0.1:5000/send_tree_data'

# Initialize the output variable
tree_data = 'Has not been generated yet'

# Check if the script should run

try:
    # Send a GET request to fetch the data
    response = requests.get(url)
    
    # Check the response status code
    if response.status_code == 200:
        data = response.json()
        tree_data = data.get("tree_data", data)  # handle if it's nested or flat
        print(f"Received complete tree data: {tree_data}")
    else:
        print(f"Failed to connect: {response.status_code}")
        tree_data = 'Failed'
except Exception as e:
    print(f"Error: {e}")
    tree_data = 'Error'

# Assign the complete data to Grasshopper
a = tree_data

# === Initialize all expected variables ===
tree_ids = []
tree_positions = []
tree_types = []
pwr_names = []
pwr_values = []

# === Extract data if valid ===
if isinstance(tree_data, dict) and tree_data not in ['Has not been generated yet', 'Failed', 'Error']:
    try:
        # Extract tree placement
        if "tree_placement" in tree_data:
            placement = tree_data["tree_placement"]
            if isinstance(placement, dict):
                tree_ids = list(placement.keys())
                tree_positions = list(placement.values())

        # Extract PWR data
        if "PWR" in tree_data:
            pwr = tree_data["PWR"]
            if isinstance(pwr, dict):
                pwr_names = list(pwr.keys())
                pwr_values = []
                for val in pwr.values():
                    try:
                        pwr_values.append(float(val))
                    except:
                        pwr_values.append(None)

        print("Successfully extracted tree placement and PWR data.")
        print(f"Tree IDs: {len(tree_ids)}")
        print(f"PWR entries: {len(pwr_names)}")

    except Exception as e:
        print(f"Error extracting tree data: {e}")
else:
    print("No valid tree data available.")

# === Final assignments for Grasshopper outputs ===
tree_ids = tree_ids
tree_positions = tree_positions
pwr_names = pwr_names
pwr_values = pwr_values
# ---------- end tree_data ----------
preview_bitmap = PreviewBitmap(Bitmap=ghpython_script, LockAspect=False)
query_data = Python3Script()  # -> out, a
# ---------- query_data: Python ----------
# requirements: requests
import requests
import json

# Define the URL for the Flask server endpoint
url = 'http://127.0.0.1:5000/query_results'

# Initialize the output variable
query_data = None

# Check if the script should run

try:
    # Send a GET request to fetch the data
    response = requests.get(url)
    
    # Check the response status code
    if response.status_code == 200:
        # Get the complete query data structure
        query_data = response.json()
        print("✅ Successfully received query data")
    else:
        print(f"❌ Failed to connect: {response.status_code}")
        query_data = None
except Exception as e:
    print(f"❌ Error: {e}")
    query_data = None

# Extract data from query results (flexible approach)
if query_data and isinstance(query_data, dict):
    try:
        raw_data = query_data['query_results']['raw_data']
        
        if raw_data and len(raw_data) > 0:
            # Get all unique values from the first entry (assuming it's representative)
            first_entry = raw_data[0]
            print(f"📋 Available keys in data: {list(first_entry.keys())}")
            
            # Extract all unique values from all entries
            all_values = []
            for entry in raw_data:
                for key, value in entry.items():
                    if value is not None and str(value).strip():  # Skip empty values
                        all_values.append(str(value))
            
            # Remove duplicates and sort
            window_names = sorted(list(set(all_values)))
            print(f"✅ Extracted {len(window_names)} unique values: {window_names}")
        else:
            window_names = ["No data available"]
            print("⚠️ Raw data is empty")
    except KeyError as e:
        window_names = [f"KeyError: {e}"]
        print(f"❌ KeyError: {e}")
    except Exception as e:
        window_names = [f"Error: {e}"]
        print(f"❌ Error extracting data: {e}")
else:
    window_names = ["No valid query data"]
    print("⚠️ No valid query data received")

# Output list of unique values
a = window_names
# ---------- end query_data ----------
graph_data = Python3Script()  # -> out, a, b
# ---------- graph_data: Python ----------
# requirements: requests
import requests
import json

# Define the URL for the Flask server endpoint
url = 'http://127.0.0.1:5000/graph_data'

# Initialize the output variable
graph_data = None
a_string = None

# Check if the script should run

try:
    # Send a GET request to fetch the data
    response = requests.get(url)
    
    # Check the response status code
    if response.status_code == 200:
        # Get the complete graph data structure
        graph_data = response.json()
        print(f"Received complete graph data structure")
        a_string = json.dumps(graph_data)
        print(f"string : {a_string}")
    else:
        print(f"Failed to connect: {response.status_code}")
        graph_data = None
except Exception as e:
    print(f"Error: {e}")
    graph_data = None

# Assign the complete JSON structure to Grasshopper
a = graph_data
b = a_string
# ---------- end graph_data ----------
screenshot = Python3Script(bitmap=ghpython_script)  # -> out, a
# ---------- screenshot: Python ----------
# Grasshopper Python Script - Simple Screenshot
# Input: bitmap (Bitmap)
# Output: status (Text)

import requests
import tempfile
import os
import System

def send_bitmap_to_server(bitmap, server_url):
    """Send bitmap directly to server without saving to file first"""
    try:
        # Convert bitmap to memory stream
        stream = System.IO.MemoryStream()
        bitmap.Save(stream, System.Drawing.Imaging.ImageFormat.Png)
        stream.Position = 0
        
        # Convert to bytes
        bytes_data = stream.ToArray()
        
        # Send to server
        response = requests.post(server_url, files={'image': ('screenshot.png', bytes_data, 'image/png')})
        return response.status_code, response.text
        
    except Exception as e:
        return 500, f"Error: {str(e)}"

# --- MAIN EXECUTION ---
# Input: bitmap from Grasshopper
if bitmap:
    FLASK_ENDPOINT = "http://127.0.0.1:5000/upload_screenshot"
    
    status, resp = send_bitmap_to_server(bitmap, FLASK_ENDPOINT)
    print(f"Screenshot sent! Status: {status}, Response: {resp}")
    
    # Output status for Grasshopper
    status = f"Status: {status}, Response: {resp}"
else:
    status = "No bitmap input provided"
# ---------- end screenshot ----------
panel = Panel(tree_data.tree_ids)
panel_2 = Panel(tree_data.tree_positions)
panel_3 = Panel(tree_data.pwr_names)
panel_4 = Panel(tree_data.pwr_values)
panel_5 = Panel(tree_data.a)
python_3_script = Python3Script(graph_data_string=graph_data.b)  # -> out, circles, anchor_circles, lines_movable, lines_anchor, final_position, final_position_names, anchor_position, anchor_names_out
# ---------- python_3_script: Python ----------
import Rhino.Geometry as rg
import networkx as nx
import json
import os
from networkx.readwrite import json_graph

# --- INPUT: file_path should come from a Panel or File Path component ---
# if not file_path or not os.path.exists(file_path):
#     raise Exception("Valid file path not provided or file does not exist.")

# # --- 1. Load Graph from JSON ---
# with open(file_path, "r") as f:
#     graph_data = json.load(f)

graph_data_string = graph_data_string

try:
    graph_data = json.loads(graph_data_string)
except Exception as e:
    raise Exception(f"Failed to parse JSON string: {e}")

G = json_graph.node_link_graph(graph_data)

# --- 2. Restore positions as Rhino Points ---
positions = {}
for node in G.nodes:
    pos_data = G.nodes[node].get("pos", {})
    x = pos_data.get("x", 0.0)
    y = pos_data.get("y", 0.0)
    z = pos_data.get("z", 0.0)
    
    pt = rg.Point3d(x, y, z)
    G.nodes[node]["pos"] = pt
    positions[node] = pt

    # pos_data = G.nodes[node]["pos"]
    # pt = rg.Point3d(pos_data["x"], pos_data["y"], pos_data["z"])
    # G.nodes[node]["pos"] = pt
    # positions[node] = pt

# --- 3. Geometry Outputs ---
circles = []
anchor_circles = []
lines_movable = []
lines_anchor = []

for name, pt in positions.items():
    is_anchor = G.nodes[name].get("anchor", False)
    r = G.nodes[name].get("weight", 1.0)
    circle = rg.Circle(rg.Plane(pt, rg.Vector3d.ZAxis), r)
    (anchor_circles if is_anchor else circles).append(circle)

# Edges
for u, v in G.edges:
    u_anchor = G.nodes[u].get("anchor", False)
    v_anchor = G.nodes[v].get("anchor", False)
    line = rg.Line(positions[u], positions[v])
    if u_anchor or v_anchor:
        lines_anchor.append(line)
    else:
        lines_movable.append(line)

# --- 4. Output ---
final_position = [pt for name, pt in positions.items() if not G.nodes[name].get("anchor", False)]
final_position_names = [name for name in positions if not G.nodes[name].get("anchor", False)]

anchor_position = [pt for name, pt in positions.items() if G.nodes[name].get("anchor", False)]
anchor_names_out = [name for name in positions if G.nodes[name].get("anchor", False)]
# ---------- end python_3_script ----------
panel_6 = Panel(geometry_data.position_names)
panel_7 = Panel(geometry_data.links_sources)
panel_8 = Panel(geometry_data.cardinal_names)
panel_9 = Panel(geometry_data.spaces_values)
panel_10 = Panel(geometry_data.anchors_names)
panel_11 = Panel(geometry_data.anchors_values)
panel_12 = Panel(geometry_data.position_num)
panel_13 = Panel(geometry_data.spaces_list)
panel_14 = Panel(geometry_data.weights_names)
panel_15 = Panel(geometry_data.pos_names)
panel_16 = Panel(geometry_data.links_targets)
panel_17 = Panel(geometry_data.weights_values)
panel_18 = Panel(geometry_data.pos_coords)
panel_19 = Panel(geometry_data.cardinal_dirs)
panel_20 = Panel(query_data.a)
panel_21 = Panel(python_3_script.final_position)
space = Data(panel_2)
pwr = Data(panel_4)
name = Data(panel)
concatenate = Concatenate(Fragment_A=panel_8, Fragment_B=",", A=panel_19)
concatenate_2 = Concatenate(Fragment_A=panel_7, Fragment_B=",", A=panel_16)
concatenate_3 = Concatenate(Fragment_A=panel_13, Fragment_B=", ", A=panel_9)
concatenate_4 = Concatenate(Fragment_A=panel_6, Fragment_B=",", A=panel_12)
text_tag = TextTag(Location=python_3_script.anchor_position, Text=python_3_script.anchor_names_out)
text_tag_2 = TextTag(Location=python_3_script.final_position, Text=python_3_script.final_position_names)
panel_22 = Panel(concatenate)
panel_23 = Panel(concatenate_2)
target_positions = Panel(concatenate_3)
panel_24 = Panel(concatenate_4)
connections_cardinals_anchor = Data(panel_22)
connections_external = Data(panel_24)
connections_movable = Data(panel_23)
external_functions = Data(panel_10)
courtyard_functions = Data(panel_14)
target_positions_2 = Data(target_positions)
panel_25 = Panel(target_positions_2)
panel_26 = Panel(external_functions)
panel_27 = Panel(connections_movable)
panel_28 = Panel(courtyard_functions)
panel_29 = Panel(connections_cardinals_anchor)
panel_30 = Panel(connections_external)

ggifc_readfile = GgIFCReadFile(FilePath=file_path, Transform=True)  # -> Project, Filtered
panel_31 = Panel(file_path)
ggifc_decompose_project = GgIFCDecomposeProject(IFCProject=ggifc_readfile.Project)  # -> GlobalID, Name, Description, IFCRootSiteOrBuilding, LongName, Phase, Contexts, IFCTypeProducts
ggifc_extract = GgIFCExtract(IFCEntity=ggifc_decompose_project.IFCRootSiteOrBuilding, ClassName="IfcWindow")
ggifc_extract_2 = GgIFCExtract(IFCEntity=ggifc_decompose_project.IFCRootSiteOrBuilding, ClassName="IfcSpace")
ggifc_decompose_product = GgIFCDecomposeProduct(IfcProduct=ggifc_extract)  # -> GlobalID, Name, Description, ObjectType, RelatedType, IsDefinedBy, Placement, Representation
ggifc_decompose_product_2 = GgIFCDecomposeProduct(IfcProduct=ggifc_extract_2)  # -> GlobalID, Name, Description, ObjectType, RelatedType, IsDefinedBy, Placement, Representation
geometry = Geometry(ggifc_extract)
mesh = Mesh(ggifc_extract_2)
file_path_3 = FilePath("F:\nodes_final (2).csv")
graph_query_ids = Data(panel_20)
panel_32 = Panel(file_path_3)
python_3_script_2 = Python3Script(comunities_path=file_path_2)  # -> out, comunities, nodes
# ---------- python_3_script_2: Python ----------
import json
from ghpythonlib.treehelpers import list_to_tree


with open(comunities_path, 'r') as f:
    data = json.load(f)


comunities = list(data.keys())
nodes = list_to_tree(list(data.values()))
# ---------- end python_3_script_2 ----------
python_3_script_3 = Python3Script(csv_path=file_path_3, filter_column="GlobalId", target_value=graph_query_ids)  # -> out, filtered_ids; inputs target_value: list
# ---------- python_3_script_3: Python ----------
import csv

filtered_ids = []
target_ids = target_value  # List of IDs you want to highlight

with open(csv_path, newline='', encoding='utf-8') as csvfile:
    reader = csv.DictReader(csvfile)
    for row in reader:
        gid = row.get("GlobalId")
        val = row.get(filter_column)

        if gid is not None and val is not None:
            # Check if this ID matches any of the target IDs
            if gid.strip() in [tid.strip() for tid in target_ids]:
                filtered_ids.append(gid)
# ---------- end python_3_script_3 ----------
member_index = MemberIndex(Set=python_3_script_3.filtered_ids, Member=python_3_script_2.nodes)  # -> Index, Count
path_mapper = PathMapper(member_index.Index, source="{A;B;C}", target="{A;B}")
clean_tree = CleanTree(RemoveNulls=False, RemoveInvalid=False, RemoveEmpty=True, Tree=path_mapper)
panel_33 = Panel(clean_tree)
tree_statistics = TreeStatistics(Tree=clean_tree)  # -> Paths, Length, Count
tree_branch = TreeBranch(Tree=python_3_script_2.nodes, Path=tree_statistics.Paths, MaintainPaths=True)
member_index_2 = MemberIndex(Set=ggifc_decompose_product_2.GlobalID, Member=tree_branch)  # -> Index, Count
shift_paths = ShiftPaths(Data=member_index_2.Index, Offset=-1)
mesh_2 = Mesh(ggifc_extract_2)
list_item = ListItem(List=mesh_2, Index=shift_paths, Wrap=True)
tree_statistics_2 = TreeStatistics(Tree=list_item)  # -> Paths, Length, Count
center = Center(Geometry=list_item)  # -> Center, Dimension
series = Series(Start="1", Step="1", Count=tree_statistics_2.Count)
series_2 = Series(Start=0, Step=1, Count=tree_statistics_2.Count)
gradient = Gradient(
    LowerLimit="0",
    UpperLimit=tree_statistics_2.Count,
    Parameter=series_2,
    stops=[0: RGB(243, 57, 0), 0.1: RGB(236, 27, 60), 0.2: RGB(210, 0, 118), 0.3: RGB(103, 0, 120), 0.4: RGB(39, 72, 161), 0.5: RGB(1, 192, 229), 0.6: RGB(18, 178, 90), 0.7: RGB(79, 186, 8), 0.8: RGB(220, 237, 32), 0.9: RGB(247, 159, 20), 1: RGB(243, 57, 0)])
custom_preview = CustomPreview(Geometry=list_item, Material=graft(gradient))
text_tag_3 = TextTag(Location=center.Center, Text=graft(series), Colour=gradient)

bdg_model = Mesh(ggifc_extract_2)

member_index_3 = MemberIndex(Set=ggifc_decompose_product_2.GlobalID, Member="3J1to6OpPB2OsWLPzi983z")  # -> Index, Count
list_item_2 = ListItem(List=mesh, Index=member_index_3.Index, Wrap=True)
full_building_from_other_file = Mesh(bdg_model)
courtyard_surface = Geometry(list_item_2)
bounding_box = BoundingBox(Content=courtyard_surface, Plane=PlaneXY(0, 0, 0))  # -> Box, Box_2
bounding_box_2 = BoundingBox(Content=full_building_from_other_file, Plane=PlaneXY(0, 0, 0))  # -> Box, Box_2
area = Area(Geometry=bounding_box.Box)  # -> Area, Centroid
area_2 = Area(Geometry=bounding_box_2.Box)  # -> Area, Centroid
equality = Equality(FirstNumber=area.Area, SecondNumber=area_2.Area)  # -> Equality, Inequality

deconstruct_mesh = DeconstructMesh(Mesh=courtyard_surface)  # -> Vertices, Faces, Colours, Normals
deconstruct = Deconstruct(Point=deconstruct_mesh.Vertices)  # -> XComponent, YComponent, ZComponent
smaller_than = SmallerThan(FirstNumber=deconstruct.ZComponent, SecondNumber="3")  # -> SmallerThan, OrEqualTo
panel_34 = Panel(deconstruct.ZComponent)
cull_pattern = CullPattern(List=deconstruct_mesh.Vertices, CullPattern=smaller_than.SmallerThan)
gene_pool = GenePool(Decimals=1, Maximum=10, Minimum=0, Value=[5, 5, 5, 5, 5])
list_length = ListLength(List=courtyard_functions)
panel_35 = Panel("""S
E
N
W""")
cull_duplicates = CullDuplicates(Points=cull_pattern, Tolerance=0.1, CullMode=3)  # -> Points, Indices, Valence
genepool_controller = GenePoolController(GenePool=gene_pool, Count=list_length, Randomness=0.1)
polyline = PolyLine(Vertices=cull_duplicates.Points, Closed=True)
curve = Curve(polyline)
boundary_surfaces = BoundarySurfaces(Edges=curve)
offset_curve = OffsetCurve(Curve=curve, Distance=Slider(5, range=0..10), Corners=1)
splitatcorners = SplitAtCorners(Poly=offset_curve, Angle=1)  # -> Corners, Parts
divide_domain² = DivideDomain²(Domain=boundary_surfaces, UCount="17", VCount="17")
bounding_box_3 = BoundingBox(Content=boundary_surfaces, Plane=PlaneXY(0, 0, 0))  # -> Box, Box_2
point_on_curve = PointOnCurve(splitatcorners.Parts, parameter=0.5)
isotrim = Isotrim(Surface=boundary_surfaces, Domain=divide_domain²)
divide_curve = DivideCurve(Curve=curve, Count="100", Kinks=False)  # -> Points, Tangents, Parameters
deconstruct_brep = DeconstructBrep(Brep=bounding_box_3.Box)  # -> Faces, Edges, Vertices
custom_preview_2 = CustomPreview(Geometry=curve, Material=ColourSwatch(SwatchColor=RGB(135, 135, 135)))
populate_geometry = PopulateGeometry(Geometry=courtyard_surface, Count=list_length, Seed=1, Points=divide_curve.Points)
text_tag_4 = TextTag(Location=point_on_curve, Text=panel_35, Colour=ColourSwatch(SwatchColor=RGB(150, 150, 150)))
list_item_3 = ListItem(List=deconstruct_brep.Edges, Index=0, Wrap=True)
list_item_4 = ListItem(List=deconstruct_brep.Edges, Index=1, Wrap=True)
point_list = PointList(Points=point_on_curve, Size=Slider(1, range=0..1))
area_3 = Area(Geometry=isotrim)  # -> Area, Centroid
areas = Panel("""1
2
1
3""")
mass_addition = MassAddition(Input=area_3.Area)  # -> Result, PartialResults
length = Length(Curve=list_item_4)
length_2 = Length(Curve=list_item_3)
boundary_surfaces_2 = BoundarySurfaces(Edges=polyline)
text_tag_3d = TextTag3D(
    Location=cull_duplicates.Points,
    Text=external_functions,
    Size=Slider(0.6, range=0..1),
    Colour=ColourSwatch(SwatchColor=RGB(201, 91, 128)),
    Justification=8)

area_4 = Panel(mass_addition.Result)
panel_36 = Panel(cull_duplicates.Points)
courtyard_length = Data(length_2)
courtyard_width = Data(length)
area_5 = Python3Script(input_area=area_4)  # -> out, out_2; inputs input_area: Double
# ---------- area_5: Python ----------
# requirements: requests


import requests

url = 'http://localhost:5000/plot_area'
payload = {'input': str(input_area)}


out = None

response = requests.post(url, json=payload)

if response.status_code == 200:
    out = "Data was sent to AI Assistant"
else:
    out = "Failed to connect:"

a = out
# ---------- end area_5 ----------
coordinates_width_length = Python3Script(coordinates_input=panel_36, width=courtyard_width, length=courtyard_length)  # -> out, a; inputs coordinates_input: list of Point3d
# ---------- coordinates_width_length: Python ----------
# requirements: requests
import requests

url = 'http://localhost:5000/external_function_placement'

out = None


try:
    # Convert input data to a list of coordinates
    coordinates_for_json = []
    first_item = coordinates_input[0]

    if hasattr(first_item, 'X') and hasattr(first_item, 'Y'):
        for point in coordinates_input:
            if hasattr(point, 'X'):
                    coordinates_for_json.append([point.X, point.Y, point.Z])
    
    elif isinstance(first_item, (float, int)):
        for i in range(0, len(coordinates_input), 3):
            if i + 2 < len(coordinates_input):
                coordinates_for_json.append([coordinates_input[i], coordinates_input[i+1], coordinates_input[i+2]])
    else:
        raise TypeError("Input list does not contain Point objects or numbers.")

    if not coordinates_for_json:
        raise ValueError("Conversion Error: No valid points were created from the input.")

    # Create payload and send to server
    payload = {
        "external_function_placement": {
            "width": width, 
            "length": length, 
            "coordinates": coordinates_for_json
        }
    }
    
    response = requests.post(url, json=payload, timeout=10)

    if response.status_code == 200:
        out = "Data was sent to AI Assistant"
    else:
        out = f"Failed to connect: {response.status_code}"
        
except Exception as e:
    out = f"Error: {e}"

a = out
# ---------- end coordinates_width_length ----------
panel_37 = Panel(coordinates_width_length.a)
panel_38 = Panel(area_5.out_2)

number_slider = Slider(10, range=0..10)
pull_strength = Slider(0.2, range=0..2)
point = Point(populate_geometry)
python_3_script_4 = Python3Script(
    anchor_points=point_on_curve,
    anchor_names=panel_35,
    anchor_points2=cull_duplicates.Points,
    anchor_names2=external_functions,
    names=courtyard_functions,
    pull_strength=pull_strength,
    anchor_attractor_strength=Slider(0.1, range=0..1),
    rect=curve,
    points=point,
    connections_movable=connections_movable,
    connections_anchor=connections_cardinals_anchor,
    connections_anchor2=connections_external,
    weights=gene_pool,
    target_map_raw=target_positions_2,
    grid_cols="3",
    grid_rows="3",
    iterations=Slider(200, range=0..1000),
    reset=Toggle(True))  # -> out, final_position, lines_movable, lines_anchor, circles, grid_points, name_map, final_position_names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; inputs anchor_points: list of Point3d, anchor_names: list of String, anchor_points2: list of Point3d, anchor_names2: list of String, names: list of String, pull_strength: Double, anchor_attractor_strength: Double, rect: Rectangle3d, points: list of Point3d, connections_movable: list of String, connections_anchor: list of String, connections_anchor2: list of String, weights: list of Double, target_map_raw: list of String, grid_cols: Int32, grid_rows: Int32, iterations: Int32
# ---------- python_3_script_4: Python ----------
# r: networkx, numpy

import Rhino.Geometry as rg
import networkx as nx
import json
from networkx.readwrite import json_graph

# --- PARAMETERS ---
iterations = 500
edge_attraction_strength = 0.5
pull_strength = 2
anchor_attractor_strength1 = 0.05
anchor_attractor_strength2 = 0.2
repulsion_margin = 2.5
reset = False

# --- 0. Init ---
G = nx.Graph()
name_map = {}

# --- 1. Movable Nodes ---
for i, pt in enumerate(points):
    name = names[i] if i < len(names) else f"Node_{i}"
    weight = weights[i] if i < len(weights) else 1.0
    G.add_node(name, pos=pt, weight=weight, anchor=False)
    name_map[i] = name

# --- 2. Anchors ---
anchor_sets = [
    (anchor_points, anchor_names),
    (anchor_points2, anchor_names2)
]

offset = len(points)
for s_idx, (apts, anames) in enumerate(anchor_sets):
    for i, pt in enumerate(apts):
        name = anames[i] if anames and i < len(anames) else f"Anchor{s_idx}_{i}"
        G.add_node(name, pos=pt, weight=1.0, anchor=True)
        name_map[offset] = name
        offset += 1

# --- 3. Connections ---
def resolve_name(val):
    return name_map.get(val) if isinstance(val, int) else str(val)

def parse_connections(raw_list):
    conns = []
    for conn in raw_list:
        try:
            a, b = conn.strip().split(',') if isinstance(conn, str) else conn
            a, b = resolve_name(a), resolve_name(b)
            if a in G.nodes and b in G.nodes:
                conns.append((a, b))
        except:
            continue
    return conns

edges_movable = parse_connections(connections_movable)
edges_anchor1 = parse_connections(connections_anchor)
edges_anchor2 = parse_connections(connections_anchor2)

for u, v in edges_movable + edges_anchor1 + edges_anchor2:
    G.add_edge(u, v)

# --- 4. Initial Positions using spring_layout ---
layout = nx.spring_layout(G, iterations=50)
for name in G.nodes:
    if not G.nodes[name]['anchor']:
        x, y = layout[name]
        G.nodes[name]['pos'] = rg.Point3d(x, y, 0)

positions = {name: G.nodes[name]['pos'] for name in G.nodes}

# --- 5. Grid Setup ---
x_min, y_min = rect.Corner(0).X, rect.Corner(0).Y
x_max, y_max = rect.Corner(2).X, rect.Corner(2).Y
tile_w = (x_max - x_min) / float(grid_cols)
tile_h = (y_max - y_min) / float(grid_rows)

grid_points = []
for i in range(grid_cols):
    for j in range(grid_rows):
        cx = x_min + (i + 0.5) * tile_w
        cy = y_min + (j + 0.5) * tile_h
        grid_points.append(rg.Point3d(cx, cy, 0))

grid_point_geometries = grid_points
grid_point_ids = list(range(len(grid_points)))

# --- 6. Target Mapping ---
node_targets = {}
for item in target_map_raw:
    try:
        a, b = item.strip().split(',') if isinstance(item, str) else item
        a = resolve_name(a)
        b = int(b)
        if a in G.nodes:
            node_targets[a] = b
    except:
        continue

# --- 7. Clamp Helper ---
def clamp_to_rect(pt, r):
    x = min(max(pt.X, x_min + r), x_max - r)
    y = min(max(pt.Y, y_min + r), y_max - r)
    return rg.Point3d(x, y, pt.Z)

# Clamp radius
max_r = min(tile_w, tile_h) * 0.4
for n in G.nodes:
    G.nodes[n]['weight'] = min(G.nodes[n]['weight'], max_r)

# --- 8. Relaxation ---
def relax(positions, iterations=100, node_targets={}):
    from Rhino.Geometry import RTree, BoundingBox

    def spring_attract(p1, p2, strength):
        vec = p2 - p1
        dist = vec.Length
        if dist < 1e-6:
            return rg.Vector3d(0, 0, 0)
        vec.Unitize()
        return vec * (dist * strength)

    new_pos = positions.copy()
    node_weights = {n: G.nodes[n]['weight'] for n in G.nodes}

    for _ in range(iterations):
        # a. Movable attraction
        for u, v in edges_movable:
            pt_u, pt_v = new_pos[u], new_pos[v]
            r_u, r_v = node_weights[u], node_weights[v]
            target = r_u + r_v
            vec = pt_v - pt_u
            dist = vec.Length
            if dist < 1e-6: continue
            vec.Unitize()
            move_vec = vec * ((target - dist) * edge_attraction_strength)
            if not G.nodes[u]['anchor']:
                new_pos[u] = clamp_to_rect(pt_u - move_vec, r_u)
            if not G.nodes[v]['anchor']:
                new_pos[v] = clamp_to_rect(pt_v + move_vec, r_v)

        # b. Repel overlaps
        rtree = RTree()
        keys = list(new_pos.keys())
        for i, pt in enumerate(new_pos.values()):
            rtree.Insert(pt, i)

        updated = new_pos.copy()
        for i, name_i in enumerate(keys):
            pt1 = new_pos[name_i]
            r1 = node_weights[name_i]
            bbox = BoundingBox(
                rg.Point3d(pt1.X - r1*repulsion_margin, pt1.Y - r1*repulsion_margin, pt1.Z),
                rg.Point3d(pt1.X + r1*repulsion_margin, pt1.Y + r1*repulsion_margin, pt1.Z)
            )
            indices = []
            rtree.Search(bbox, lambda s, a: indices.append(a.Id))
            for j in indices:
                if j <= i: continue
                name_j = keys[j]
                pt2 = new_pos[name_j]
                r2 = node_weights[name_j]
                vec = pt2 - pt1
                dist = vec.Length
                min_dist = r1 + r2
                if dist < min_dist and dist > 1e-6:
                    vec.Unitize()
                    move_vec = vec * ((min_dist - dist) * 0.8)
                    if not G.nodes[name_i]['anchor']:
                        updated[name_i] = clamp_to_rect(pt1 - move_vec, r1)
                    if not G.nodes[name_j]['anchor']:
                        updated[name_j] = clamp_to_rect(pt2 + move_vec, r2)
        new_pos = updated

        # c. Pull to grid
        for name, grid_idx in node_targets.items():
            if G.nodes[name]['anchor']: continue
            if 0 <= grid_idx < len(grid_points):
                pt = new_pos[name]
                target = grid_points[grid_idx]
                vec = target - pt
                dist = vec.Length
                if dist > 1e-6:
                    vec.Unitize()
                    vec *= dist * pull_strength
                    new_pos[name] = clamp_to_rect(pt + vec, node_weights[name])

        # d. Anchor forces
        for u, v in edges_anchor1:
            if G.nodes[u]['anchor'] and not G.nodes[v]['anchor']:
                move_vec = spring_attract(new_pos[v], new_pos[u], anchor_attractor_strength1)
                new_pos[v] = clamp_to_rect(new_pos[v] + move_vec, node_weights[v])
            elif G.nodes[v]['anchor'] and not G.nodes[u]['anchor']:
                move_vec = spring_attract(new_pos[u], new_pos[v], anchor_attractor_strength1)
                new_pos[u] = clamp_to_rect(new_pos[u] + move_vec, node_weights[u])

        for u, v in edges_anchor2:
            if G.nodes[u]['anchor'] and not G.nodes[v]['anchor']:
                move_vec = spring_attract(new_pos[v], new_pos[u], anchor_attractor_strength2)
                new_pos[v] = clamp_to_rect(new_pos[v] + move_vec, node_weights[v])
            elif G.nodes[v]['anchor'] and not G.nodes[u]['anchor']:
                move_vec = spring_attract(new_pos[u], new_pos[v], anchor_attractor_strength2)
                new_pos[u] = clamp_to_rect(new_pos[u] + move_vec, node_weights[u])

    return new_pos

# --- 9. Run Relaxation ---
final_positions = positions.copy() if reset else relax(positions, iterations, node_targets)

# --- 10. Geometry Output ---
circles = []
anchor_circles = []
lines_movable = []
lines_anchor = []

for name, pt in final_positions.items():
    is_anchor = G.nodes[name]['anchor']
    r = G.nodes[name]['weight']
    circle = rg.Circle(rg.Plane(pt, rg.Vector3d.ZAxis), r)
    (anchor_circles if is_anchor else circles).append(circle)

for u, v in edges_movable:
    lines_movable.append(rg.Line(final_positions[u], final_positions[v]))
for u, v in edges_anchor1 + edges_anchor2:
    lines_anchor.append(rg.Line(final_positions[u], final_positions[v]))

final_position = [pt for name, pt in final_positions.items() if not G.nodes[name]['anchor']]
final_position_names = [name for name in final_positions if not G.nodes[name]['anchor']]
anchor_position = [pt for name, pt in final_positions.items() if G.nodes[name]['anchor']]
anchor_names_out = [name for name in final_positions if G.nodes[name]['anchor']]
grid_point_geometries = grid_points
grid_point_ids = list(range(len(grid_points)))

# --- 11. Debug Grid Pull Lines ---
grid_pull_lines = []
for name, grid_idx in node_targets.items():
    if name in final_positions and 0 <= grid_idx < len(grid_points):
        p = final_positions[name]
        g = grid_points[grid_idx]
        grid_pull_lines.append(rg.Line(p, g))

# --- 12. JSON Export (Place this at the end) ---

for name, pt in final_positions.items():
    G.nodes[name]['pos'] = pt  # this ensures JSON includes the correct, relaxed positions

graph_data = json_graph.node_link_data(G)
for node in graph_data["nodes"]:
    pt = G.nodes[node["id"]]["pos"]
    node["pos"] = {"x": pt.X, "y": pt.Y, "z": 0.0}
    node["anchor"] = G.nodes[node["id"]]["anchor"]
    node["weight"] = G.nodes[node["id"]]["weight"]

graph_json = json.dumps(graph_data, indent=2)

import os

# Path to save file
file_path = r"F:\network_graph.json"

# Write JSON string to file
with open(file_path, "w") as f:
    f.write(graph_json)


# Optional debug print
print("Graph with named nodes:")
print(G.nodes(data=True))
# ---------- end python_3_script_4 ----------
final_position_names = Data(python_3_script.final_position_names)
anchor_names_out = Data(python_3_script.anchor_names_out)
anchor_position = Data(python_3_script.anchor_position)
lines_movable = Curve(python_3_script.lines_movable)
final_position = Data(python_3_script.final_position)
anchor_circles = Curve(python_3_script.anchor_circles)
lines_anchor = Curve(python_3_script.lines_anchor)
graph_json = Data(graph_data.b)
circles = Curve(python_3_script.circles)
panel_39 = Panel(graph_json)
panel_40 = Panel(python_3_script_4.grid_point_geometries)
panel_42 = Panel(final_position)
point_2 = Point(python_3_script_4.grid_points)
point_list_2 = PointList(Points=point_2, Size=Slider(0.7, range=0..1))
move = Move(Geometry=final_position, Motion=Vector(0, 0, 1))  # -> Geometry, Transform
text_tag_3d_2 = TextTag3D(
    Location=move.Geometry,
    Text=courtyard_functions,
    Size=Slider(0.6, range=0..1),
    Colour=ColourSwatch(SwatchColor=RGB(74, 74, 74)),
    Justification=7)

splitatcorners_2 = SplitAtCorners(Poly=curve, Angle=1)  # -> Corners, Parts
point_on_curve_2 = PointOnCurve(splitatcorners_2.Parts, parameter=0.5)
polyline_2 = PolyLine(Vertices=splitatcorners_2.Corners, Closed=True)
point_list_3 = PointList(Points=point_on_curve_2, Size=Slider(1, range=0..1))
triremesh = TriRemesh(Geometry=polyline_2, Length=Slider(2, range=0..10), Iterations=25)  # -> Triangulation, Dual, Creases
mesh_3 = Mesh(triremesh.Triangulation)
mesh_4 = Mesh(triremesh.Dual)
smooth_mesh = SmoothMesh(Mesh=mesh_3, Strength=0.5, SkipNaked=True, Iterations=Slider(200, range=0..1000))
mesh_explode = MeshExplode(Mesh=smooth_mesh, Interpolate=False)
deconstruct_mesh_2 = DeconstructMesh(Mesh=mesh_explode)  # -> Vertices, Faces, Colours, Normals
mass_addition_2 = MassAddition(Input=gene_pool)  # -> Result, PartialResults
polyline_3 = PolyLine(Vertices=deconstruct_mesh_2.Vertices, Closed=True)
concatenate_5 = Concatenate(FragmentA="0 to ", FragmentB=mass_addition_2.Result)
boundary_surfaces_3 = BoundarySurfaces(Edges=polyline_3)
area_6 = Area(Geometry=boundary_surfaces_3)  # -> Area, Centroid
area_7 = Area(Geometry=curve)  # -> Area, Centroid
remap_numbers = RemapNumbers(Value=gene_pool, Source=concatenate_5, Target="0 to 100")  # -> Mapped, Clipped
expression = Expression(x=area_7.Area, y=remap_numbers.Mapped, Expression="x*y/100")
gene_pool_2 = Data(gene_pool)
data = Data(final_position)
python_3_script_5 = Python3Script(tiles=flatten(boundary_surfaces_3), centroids=flatten(area_6.Centroid), attractors=data, targets=gene_pool_2)  # -> out, output_regions; inputs tiles: list of Brep, centroids: list of Point3d, attractors: list of Point3d, targets: list
# ---------- python_3_script_5: Python ----------
import Rhino.Geometry as rg
import Grasshopper
from Grasshopper import DataTree
from Grasshopper.Kernel.Data import GH_Path

# SETTINGS
adjacency_threshold = 1.01  # Adjust based on tile spacing

# INIT
tile_tree = DataTree[object]()
used_tile_ids = set()
indexed_tiles = list(enumerate(zip(centroids, tiles)))
id_to_tile = {idx: (c, t) for idx, (c, t) in indexed_tiles}

# STEP 1: Precompute total area and proportional tile allocation
total_target_area = sum(targets)
tile_areas = [rg.AreaMassProperties.Compute(t).Area for t in tiles]
avg_tile_area = sum(tile_areas) / len(tile_areas)
target_tile_counts = [max(1, int((a / total_target_area) * len(tiles))) for a in targets]

# Track group centroids for leftovers
group_centroids = {}

# STEP 2: Sort attractors by largest target first
attractor_info = sorted(enumerate(zip(attractors, targets, target_tile_counts)), key=lambda x: -x[1][1])

# MAIN GROUPING LOOP
for sort_idx, (i, (attractor, target_area, target_count)) in enumerate(attractor_info):
    # Start with closest unused tile
    available_tiles = [(idx, c, t) for idx, (c, t) in indexed_tiles if idx not in used_tile_ids]
    if not available_tiles:
        break

    start_tile = min(available_tiles, key=lambda x: attractor.DistanceTo(x[1]))
    group = []
    frontier = [start_tile]
    visited = set()
    path = GH_Path(i)

    while frontier and len(group) < target_count:
        idx, center, tile = frontier.pop(0)

        if idx in used_tile_ids or idx in visited:
            continue

        visited.add(idx)
        group.append((idx, center, tile))
        used_tile_ids.add(idx)
        tile_tree.Add(tile, path)

        # Grow only through neighbors within threshold
        for j, (c, t) in id_to_tile.items():
            if j in used_tile_ids or j in visited:
                continue
            if center.DistanceTo(c) <= adjacency_threshold:
                frontier.append((j, c, t))

    # Store group centroid (average of centers)
    if group:
        x = sum([pt.X for _, pt, _ in group]) / len(group)
        y = sum([pt.Y for _, pt, _ in group]) / len(group)
        z = sum([pt.Z for _, pt, _ in group]) / len(group)
        group_centroids[i] = rg.Point3d(x, y, z)

# HANDLE LEFTOVERS (disconnected tiles)
leftovers = [(idx, c, t) for idx, (c, t) in indexed_tiles if idx not in used_tile_ids]

for idx, center, tile in leftovers:
    if not group_centroids:
        continue  # no valid groups yet

    # Assign to nearest group centroid
    nearest_group = min(group_centroids.items(), key=lambda kv: center.DistanceTo(kv[1]))[0]
    path = GH_Path(nearest_group)
    tile_tree.Add(tile, path)
    used_tile_ids.add(idx)

# OUTPUT
output_regions = tile_tree
# ---------- end python_3_script_5 ----------
area_8 = Area(Geometry=python_3_script_5.output_regions)  # -> Area, Centroid
tree_statistics_3 = TreeStatistics(Tree=python_3_script_5.output_regions)  # -> Paths, Length, Count
mass_addition_3 = MassAddition(Input=area_8.Area)  # -> Result, PartialResults
series_3 = Series(Start=0, Step=1, Count=tree_statistics_3.Count)
gradient_2 = Gradient(
    LowerLimit=0,
    UpperLimit=tree_statistics_3.Count,
    Parameter=series_3,
    stops=[0: RGB(0, 98, 0), 0.25: RGB(81, 175, 17), 0.5: RGB(159, 198, 146), 0.75: RGB(170, 235, 41), 1: RGB(221, 255, 53)])
panel_43 = Panel(mass_addition_3.Result)
custom_preview_3 = CustomPreview(Geometry=python_3_script_5.output_regions, Material=graft(gradient_2))
panel_44 = Panel(expression)
convex_hull = ConvexHull(Points=area_8.Centroid, Plane=PlaneXY(0, 0, 0))  # -> Hull, HullZ, Indices
member_index_4 = MemberIndex(Set=courtyard_functions, Member="tree")  # -> Index, Count
panel_45 = Panel(member_index_4.Index)
brep = Brep(convex_hull.Hull)
mesh_5 = Mesh(brep)
custom_preview_4 = CustomPreview(Geometry=flatten(brep), Material=gradient_2)
subd_from_mesh = SubDFromMesh(Mesh=mesh_5, Creases=1, Corners=1, Interpolate=False)
concatenate_6 = Concatenate(Fragment_A="{", Fragment_B=panel_45, A="}")
tree_branch_2 = TreeBranch(Tree=brep, Path=concatenate_6, MaintainPaths=True)
custom_preview_5 = CustomPreview(Geometry=mesh_5, Material=graft(gradient_2))
subd_from_mesh_2 = SubDFromMesh(Mesh=tree_branch_2, Creases=1, Corners=1, Interpolate=False)
urbanmil = Panel("""tilia
acer
fagus
quercus""")
entwine = Entwine(Branch00=urbanmil, Branch01=name, FlattenInputs=True)
concatenate_7 = Concatenate(Fragment_A="{", Fragment_B=Slider(3, range=0..3), B=";", C="0", D=";", E=Slider(1, range=0..1), A="}")
entwine_2 = Entwine(Branch3X=entwine, FlattenInputs=False)
tree_branch_3 = TreeBranch(Tree=entwine_2, Path=concatenate_7, MaintainPaths=False)
mesh_6 = Mesh(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)
mesh_7 = Mesh(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)
mesh_8 = Mesh(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)
mesh_9 = Mesh(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)
mesh_10 = Mesh(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)
mesh_11 = Mesh(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)
mesh_12 = Mesh(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)
mesh_13 = Mesh(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)
mesh_14 = Mesh(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)
tree_area = Data(tree_branch_2)
panel_46 = Panel(tree_branch_3)
eucalyptus = SubD(mesh_9)
jacaranda = SubD(mesh_10)
aesculus = SubD(mesh_7)
platanus = SubD(mesh_12)
acer = SubD(mesh_6)
fagus = SubD(mesh_8)
pinus = SubD(mesh_11)
quercus = SubD(mesh_13)
tilia = SubD(mesh_14)
member_index_5 = MemberIndex(Set=name, Member=panel_46)  # -> Index, Count
triremesh_2 = TriRemesh(Geometry=tree_area, Length=Slider(24, range=0..100), Iterations=Slider(100, range=0..1000))  # -> Triangulation, Dual, Creases
mesh_colours = MeshColours(Mesh=acer, Colours="#4CAF50")
mesh_colours_2 = MeshColours(Mesh=aesculus, Colours="#2E7D32")
mesh_colours_3 = MeshColours(Mesh=eucalyptus, Colours="#80CBC4")
mesh_colours_4 = MeshColours(Mesh=fagus, Colours="#7CB342")
mesh_colours_5 = MeshColours(Mesh=jacaranda, Colours="#AED581")
mesh_colours_6 = MeshColours(Mesh=pinus, Colours="#00796B")
mesh_colours_7 = MeshColours(Mesh=platanus, Colours="#689F38")
mesh_colours_8 = MeshColours(Mesh=quercus, Colours="#556B2F")
mesh_colours_9 = MeshColours(Mesh=tilia, Colours="#8BC34A")
list_item_5 = ListItem(List=space, Index=flatten(member_index_5.Index), Wrap=True)
panel_47 = Panel("""5
1
4
10
8
6
3
2
7""")
curve_2 = Curve(tree_area)
panel_48 = Panel(list_item_5)
merge = Merge(
    Data1=mesh_colours,
    Data3=mesh_colours_3,
    Data5=mesh_colours_5,
    Data6=mesh_colours_6,
    Data8=mesh_colours_8,
    Data9=mesh_colours_9)
list_item_6 = ListItem(List=merge, Index=flatten(member_index_5.Index), Wrap=True)
python_3_script_6 = Python3Script(polyline=curve_2, radii=panel_47)  # -> out, a; inputs polyline: Curve, radii: list of Double
# ---------- python_3_script_6: Python ----------
import Rhino.Geometry as rg
import random

# Convert polyline to boundary curve and region
boundary = polyline.ToNurbsCurve()
bbox = polyline.GetBoundingBox(True)
region = rg.PolylineCurve(polyline)

# Store circle data
positions = []
circles = []

# 1. Generate initial random positions inside the polyline
def random_point_in_bbox(bbox):
    tries = 0
    while tries < 1000:
        x = random.uniform(bbox.Min.X, bbox.Max.X)
        y = random.uniform(bbox.Min.Y, bbox.Max.Y)
        pt = rg.Point3d(x, y, 0)
        if region.Contains(pt, rg.Plane.WorldXY, 0.01) == rg.PointContainment.Inside:
            return pt
        tries += 1
    return None

for r in radii:
    pt = random_point_in_bbox(bbox)
    if pt:
        positions.append(pt)
    else:
        positions.append(rg.Point3d(0, 0, 0))  # fallback

iterations = 300  # or however many steps you want (100–500 is typical)
# 2. Relax positions (basic force-based resolution)
for _ in range(iterations):
    for i in range(len(positions)):
        for j in range(i + 1, len(positions)):
            pi = positions[i]
            pj = positions[j]
            ri = radii[i]
            rj = radii[j]
            vec = pj - pi
            dist = vec.Length
            min_dist = ri + rj
            if dist < min_dist and dist > 0:
                move = 0.5 * (min_dist - dist)
                vec.Unitize()
                positions[i] -= vec * move
                positions[j] += vec * move

    # keep inside boundary
    for i in range(len(positions)):
        pt = positions[i]
        if region.Contains(pt, rg.Plane.WorldXY, 0.01) != rg.PointContainment.Inside:
            # Push back to center
            center = bbox.Center
            dir_vec = center - pt
            dir_vec.Unitize()
            positions[i] += dir_vec * 1.0  # small push

# 3. Create circles
for i, pt in enumerate(positions):
    circles.append(rg.Circle(pt, radii[i]))

# Output
a = circles
# ---------- end python_3_script_6 ----------
bounding_box_4 = BoundingBox(Content=merge, Plane=PlaneXY(0, 0, 0))  # -> Box, Box_2
curve_3 = Curve(python_3_script_6.a)
deconstruct_arc = DeconstructArc(Arc=curve_3)  # -> BasePlane, Radius, Angle
includes = Includes(Value=deconstruct_arc.Radius, Domain=graft(panel_48))  # -> Includes, Deviation
list_item_7 = ListItem(List=merge, Index=flatten(member_index_5.Index), Wrap=True)
dispatch_multiple = DispatchMultiple(DispatchPattern=includes.Includes, ListList0=deconstruct_arc.BasePlane)
bounding_box_5 = BoundingBox(Content=list_item_7, Plane=PlaneXY(0, 0, 0))  # -> Box, Box_2
deconstruct_brep_2 = DeconstructBrep(Brep=bounding_box_5.Box)  # -> Faces, Edges, Vertices
colour_swatch = ColourSwatch(SwatchColor=RGB(67, 158, 113))
tree_area_2 = Data(subd_from_mesh_2)
custom_preview_6 = CustomPreview(Geometry=tree_area_2, Material=colour_swatch)
custom_preview_7 = CustomPreview(Geometry=flatten(triremesh_2.Triangulation), Material=colour_swatch)
list_item_8 = ListItem(List=deconstruct_brep_2.Faces, Index=Slider(4, range=0..6), Wrap=True)
area_9 = Area(Geometry=list_item_8)  # -> Area, flatten(Centroid)
point_3 = Point(area_9.Centroid)
orient_direction = OrientDirection(
    Geometry=graft(list_item_6),
    PointA=graft(point_3),
    DirectionA=Vector(0, 0, 1),
    PointB=dispatch_multiple,
    DirectionB=Vector(0, 0, 1))  # -> Geometry, Transform

area_10 = Area(Geometry=circles)  # -> Area, Centroid
number_slider_2 = Slider(0.6, range=0..1)
unit_x = UnitX(Factor=Slider(50, range=0..100))
unit_x_2 = UnitX(Factor=Slider(51, range=0..100))
unit_x_3 = UnitX(Factor=Slider(50, range=0..100))
unit_x_4 = UnitX(Factor=Slider(50, range=0..100))
unit_x_5 = UnitX(Factor=Slider(51, range=0..100))
unit_x_6 = UnitX(Factor=Slider(50, range=0..100))
unit_x_7 = UnitX(Factor=Slider(50, range=0..100))
move_2 = Move(Geometry=final_position, Motion=unit_x_2)  # -> Geometry, Transform
move_3 = Move(Geometry=[lines_movable, lines_anchor], Motion=unit_x_3)  # -> Geometry, Transform
move_4 = Move(Geometry=area_10.Centroid, Motion=unit_x)  # -> Geometry, Transform
move_5 = Move(Geometry=python_3_script_4.anchor_points2, Motion=unit_x_4)  # -> Geometry, Transform
move_6 = Move(Geometry=anchor_position, Motion=unit_x_5)  # -> Geometry, Transform
move_7 = Move(Geometry=anchor_position, Motion=unit_x_6)  # -> Geometry, Transform
division = Division(A=gene_pool, B=10)
move_8 = Move(Geometry=python_3_script_4.grid_point_geometries, Motion=unit_x_7)  # -> Geometry, Transform
colour_swatch_2 = ColourSwatch(SwatchColor=RGB(156, 156, 156))
dot_display = DotDisplay(Point=move_4.Geometry, Colour=gradient_2, Size=division)
dot_display_2 = DotDisplay(Point=move_5.Geometry, Colour=ColourSwatch(SwatchColor=RGB(255, 0, 102)), Size=Slider(0.5, range=0..1))
dot_display_3 = DotDisplay(Point=move_7.Geometry, Colour=ColourSwatch(SwatchColor=RGB(219, 132, 167)), Size=Slider(0.5, range=0..1))
text_tag_3d_3 = TextTag3D(Location=move_2.Geometry, Text=courtyard_functions, Size=number_slider_2, Colour=colour_swatch_2, Justification=7)
text_tag_3d_4 = TextTag3D(
    Location=move_8.Geometry,
    Text=python_3_script_4.grid_point_ids,
    Size=number_slider_2,
    Colour=colour_swatch_2,
    Justification=7)
custom_preview_8 = CustomPreview(Geometry=move_3.Geometry, Material=colour_swatch_2)
text_tag_3d_5 = TextTag3D(Location=move_6.Geometry, Text=anchor_names_out, Size=number_slider_2, Colour=colour_swatch_2, Justification=7)

divided_zones = Data(brep)
function = Data(courtyard_functions)
function_2 = Data(courtyard_functions)
function_3 = Data(courtyard_functions)
member_index_6 = MemberIndex(Set=function, Member="flower")  # -> Index, Count
member_index_7 = MemberIndex(Set=function, Member="rest")  # -> Index, Count
member_index_8 = MemberIndex(Set=function_2, Member="play")  # -> Index, Count
member_index_9 = MemberIndex(Set=function_3, Member="pond")  # -> Index, Count
panel_49 = Panel(member_index_6.Index)
panel_50 = Panel(member_index_7.Index)
panel_51 = Panel(member_index_8.Index)
panel_52 = Panel(member_index_9.Index)
concatenate_8 = Concatenate(Fragment_A="{", Fragment_B=panel_49, A="}")
concatenate_9 = Concatenate(Fragment_A="{", Fragment_B=panel_50, A="}")
concatenate_10 = Concatenate(Fragment_A="{", Fragment_B=panel_51, A="}")
concatenate_11 = Concatenate(Fragment_A="{", Fragment_B=panel_52, A="}")
tree_branch_4 = TreeBranch(Tree=divided_zones, Path=concatenate_8, MaintainPaths=True)
tree_branch_5 = TreeBranch(Tree=divided_zones, Path=concatenate_9, MaintainPaths=True)
tree_branch_6 = TreeBranch(Tree=divided_zones, Path=concatenate_10, MaintainPaths=True)
tree_branch_7 = TreeBranch(Tree=divided_zones, Path=concatenate_11, MaintainPaths=True)
mesh_15 = Mesh(tree_branch_4)
mesh_16 = Mesh(tree_branch_5)
subd_from_mesh_3 = SubDFromMesh(Mesh=tree_branch_6, Creases=1, Corners=1, Interpolate=False)
mesh_17 = Mesh(tree_branch_7)
subd_from_mesh_4 = SubDFromMesh(Mesh=mesh_16, Creases=1, Corners=1, Interpolate=False)
subdedges = SubDEdges(SubD=subd_from_mesh_3, NewFormatting=False)  # -> Line, Edge, Tag, Id
triremesh_3 = TriRemesh(Geometry=mesh_16, Length=Slider(2, range=0..10), Iterations=25)  # -> Triangulation, Dual, Creases
subdedges_2 = SubDEdges(SubD=mesh_17, NewFormatting=False)  # -> Line, Edge, Tag, Id
custom_preview_9 = CustomPreview(Geometry=mesh_15, Material=ColourSwatch(SwatchColor=RGB(178, 178, 141)))
custom_preview_10 = CustomPreview(Geometry=mesh_16, Material=ColourSwatch(SwatchColor=RGB(183, 211, 113)))
split = TextSplit(Text=subdedges.Tag, Separators="\" \"")
split_2 = TextSplit(Text=subdedges_2.Tag, Separators="\" \"")
item = ListItem(List=split, Index=1, Wrap=True)  # -> flatten(Item)
nakedvertices = NakedVertices(Mesh=triremesh_3.Triangulation)  # -> ClothedIndex, NakedIndex, ClothedPts, NakedPts
item_2 = ListItem(List=split_2, Index=1, Wrap=True)  # -> flatten(Item)
tmatch = MatchText(Text=item, Pattern="naked", Case=True)
area_11 = Area(Geometry=tree_branch_5)  # -> Area, Centroid
tmatch_2 = MatchText(Text=item_2, Pattern="naked", Case=True)
list_length_2 = ListLength(List=nakedvertices.ClothedPts)
point_4 = Point(nakedvertices.ClothedPts)
cull = CullPattern(List=subdedges.Edge, CullPattern=tmatch)
cull_2 = CullPattern(List=subdedges_2.Edge, CullPattern=tmatch_2)
join_curves = JoinCurves(Curves=cull, Preserve=False)
multiplication = Multiplication(A=list_length_2, B=0.75)
join_curves_2 = JoinCurves(Curves=cull_2, Preserve=False)
boundary_surfaces_4 = BoundarySurfaces(Edges=join_curves)
random_reduce = RandomReduce(List=point_4, Reduction=multiplication, Seed=1)
vector_2pt = Vector2Pt(PointA=random_reduce, PointB=area_11.Centroid, Unitize=False)  # -> Vector, Length
unit_vector = UnitVector(Vector=vector_2pt.Vector)
populate_geometry_2 = PopulateGeometry(Geometry=boundary_surfaces_4, Count=Slider(14, range=0..100), Seed=1)
offset_curve_2 = OffsetCurve(Curve=join_curves_2, Distance="-2", Corners=1)
center_box = CenterBox(Base=PlaneXY(0, 0, 0), X=Slider(0.9, range=0..10), Y=Slider(0.4, range=0..1), Z=Slider(0.4, range=0..1))
deconstruct_brep_3 = DeconstructBrep(Brep=center_box)  # -> Faces, Edges, Vertices
voronoi = Voronoi(Points=populate_geometry_2, BruteForceOverride=False)
rebuild_curve = RebuildCurve(Curve=offset_curve_2, Count="6", Tangents=False)
unit_z = UnitZ(Factor=Slider(0.3, range=0..1))
list_item_9 = ListItem(List=deconstruct_brep_3.Faces, Index=4, Wrap=True)
trim_with_region = TrimWithRegion(Curve=voronoi, Region=boundary_surfaces_4)  # -> Inside, Outside
area_12 = Area(Geometry=list_item_9)  # -> Area, Centroid
vector_2pt_2 = Vector2Pt(PointA=area_12.Centroid, PointB=area_11.Centroid, Unitize=False)  # -> Vector, Length
unit_vector_2 = UnitVector(Vector=vector_2pt_2.Vector)
negative = Negative(Value=unit_z)
orient_direction_2 = OrientDirection(
    Geometry=graft(center_box),
    PointA=graft(area_12.Centroid),
    DirectionA=unit_vector_2,
    PointB=random_reduce,
    DirectionB=unit_vector)  # -> Geometry, Transform
curve_4 = Curve(trim_with_region.Inside)
move_9 = Move(Geometry=rebuild_curve, Motion=negative)  # -> Geometry, Transform
surface_split = SurfaceSplit(Surface=boundary_surfaces_4, Curves=flatten(curve_4))
merge_2 = Merge(Data1=join_curves_2, Data3=rebuild_curve, Data4=move_9.Geometry)
list_length_3 = ListLength(List=surface_split)
custom_preview_11 = CustomPreview(Geometry=orient_direction_2.Geometry, Material=ColourSwatch(SwatchColor=RGB(154, 161, 127)))
boundary_surfaces_5 = BoundarySurfaces(Edges=move_9.Geometry)
series_4 = Series(Start=0, Step=1, Count=list_length_3)
loft = Loft(
    Curves=flatten(merge_2),
    Options={Adjust=False, Closed=False, LoftEnds=0, LoftSimp=0, LoftType=1, Rebuild=10, Refit=0.01})
gradient_3 = Gradient(
    LowerLimit=0,
    UpperLimit=list_length_3,
    Parameter=series_4,
    stops=[0: RGB(0, 98, 0), 0.206: RGB(224, 164, 216), 0.5: RGB(159, 198, 146), 0.623: RGB(170, 235, 41), 0.798: RGB(221, 255, 53)])
brep_join = BrepJoin(Breps=loft)  # -> Breps, Closed
custom_preview_12 = CustomPreview(Geometry=surface_split, Material=gradient_3)
custom_preview_13 = CustomPreview(Geometry=flatten(brep_join.Breps), Material=ColourSwatch(SwatchColor=RGB(139, 221, 113)))
custom_preview_14 = CustomPreview(Geometry=flatten(boundary_surfaces_5), Material=ColourSwatch(SwatchColor=RGBA(179, 255, 204, 179)))

# ----
# UCTI
number_slider_3 = Slider(0.25, range=0..1)
cull_pattern_2 = CullPattern(List=full_building_from_other_file, CullPattern=equality.Inequality)
python_3_script_7 = Python3Script()  # -> out, epw_url, query, location, timestamp, full_data, hour_of_day, hour_of_year
# ---------- python_3_script_7: Python ----------
# requirements: requests

import requests



url_base = 'http://localhost:5000'

# Initialize outputs
location = None
query = None
epw_url = None
timestamp = None
full_data = None


try:
    response = requests.get(f'{url_base}/climate_data', headers={'Content-Type': 'application/json'})
    if response.status_code == 200:
        result = response.json()
        if "climate_data" in result:
            data = result["climate_data"]
            location = data.get("location", "")
            query = data.get("query", "")
            epw_url = data.get("epw_url", "")
            timestamp = data.get("timestamp", "")
            full_data = data
        else:
            full_data = "❌ No minimal climate data available. Please use the 'Send Minimal Data to Grasshopper' button in the UI."
    else:
        full_data = f"❌ HTTP error: {response.status_code}"
except Exception as e:
    full_data = f"❌ Exception: {str(e)}"

# Output variables for Grasshopper
location = location
query = query
epw_url = epw_url
timestamp = timestamp
full_data = full_data
hour_of_day = full_data["hour_of_day"]
hour_of_year = full_data["hour_of_year"]
# ---------- end python_3_script_7 ----------
exising_bdg = Geometry(cull_pattern_2)
adjust_alpha = AdjustAlpha(Color=ColourSwatch(SwatchColor=RGBA(135, 100, 28, 164)), Alpha=number_slider_3)
boolean_toggle = BooleanToggle(True)
custom_preview_15 = CustomPreview(Geometry=exising_bdg, Material=adjust_alpha)
python_3_script_8 = Python3Script(hoys=python_3_script_7.hour_of_year, run=boolean_toggle)  # -> out, start_month, start_day, start_hour, end_month, end_day, end_hour, timestep; inputs hoys: list of Int32
# ---------- python_3_script_8: Python ----------
from datetime import datetime, timedelta

def hoy_to_date(hoy):
    base = datetime(2025, 1, 1, 0, 0)  # Non-leap year
    dt = base + timedelta(hours=int(hoy))
    return dt.month, dt.day, dt.hour

# Flatten input
flat_hoys = []
try:
    for h in hoys:
        if hasattr(h, '__iter__') and not isinstance(h, str):
            flat_hoys.extend(h)
        else:
            flat_hoys.append(h)
except:
    pass

flat_hoys = sorted([int(h) for h in flat_hoys])

# Defaults
sm = sd = sh = em = ed = eh = timestep = None

if flat_hoys:
    sm, sd, sh = hoy_to_date(flat_hoys[0])
    em, ed, eh = hoy_to_date(flat_hoys[-1])
    timestep = 1  # Or infer if you want

# Outputs to plug into LB AnalysisPeriod component
_start_month_ = sm
_start_day_ = sd
_start_hour_ = sh
_end_month_ = em
_end_day_ = ed
_end_hour_ = eh
_timestep_ = timestep
# ---------- end python_3_script_8 ----------
python_3_script_9 = Python3Script(hoys=python_3_script_7.hour_of_year, run=boolean_toggle)  # -> out, start_month, start_day, start_hour, end_month, end_day, end_hour, timestep; inputs hoys: list of Int32; same code as python_3_script_8
geometry_2 = Geometry(boundary_surfaces)
weather_url = Data(python_3_script_7.epw_url)
weather_url_2 = Data(python_3_script_7.epw_url)
downloadepw = LBDownloadWeather(weather_URL=weather_url)  # -> epw_file, stat_file, ddy_file; plug-in component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
importstat = LBImportSTAT(stat_file=downloadepw.stat_file)  # -> location, ashrae_zone, koppen_zone, clear_dir_norm_rad, clear_diff_horiz_rad, ann_heat_dday_996, ann_heat_dday_990, ann_cool_dday_004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; plug-in component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
downloadepw_2 = LBDownloadWeather(weather_URL=weather_url_2)  # -> epw_file, stat_file, ddy_file; plug-in component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
importstat_2 = LBImportSTAT(stat_file=downloadepw_2.stat_file)  # -> location, ashrae_zone, koppen_zone, clear_dir_norm_rad, clear_diff_horiz_rad, ann_heat_dday_996, ann_heat_dday_990, ann_cool_dday_004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; plug-in component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
panel_53 = Panel(importstat.extreme_hot_week)
panel_54 = Panel(importstat_2.extreme_hot_week)
merge_3 = Merge(Data1=exising_bdg)  # -> flatten(Result)
merge_4 = Merge(Data1=exising_bdg, Data2=orient_direction.Geometry)  # -> flatten(Result)
importepw = LBImportEPW(epw_file=downloadepw.epw_file)  # -> location, dry_bulb_temperature, dew_point_temperature, relative_humidity, wind_speed, wind_direction, direct_normal_rad, diffuse_horizontal_rad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; plug-in component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
number_slider_4 = Slider(7, range=1..12)
number_slider_5 = Slider(2, range=1..31)
number_slider_6 = Slider(14, range=0..23)
number_slider_7 = Slider(15, range=0..23)
number_slider_8 = Slider(7, range=1..12)
number_slider_9 = Slider(2, range=1..31)
number_slider_10 = Slider(14, range=0..23)
importepw_2 = LBImportEPW(epw_file=downloadepw_2.epw_file)  # -> location, dry_bulb_temperature, dew_point_temperature, relative_humidity, wind_speed, wind_direction, direct_normal_rad, diffuse_horizontal_rad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; plug-in component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
number_slider_11 = Slider(15, range=0..23)
geometry_3 = Geometry(boundary_surfaces)
decnstrloc = LBDeconstructLocation(location=importepw.location)  # -> name, latitude, longitude, time_zone, elevation; plug-in component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
genpts = LBGeneratePointGrid(geometry=flatten(geometry_3), grid_size=Slider(3, range=0..100))  # -> flatten(points), vectors, face_areas, mesh; plug-in component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
analysisperiod = LBAnalysisPeriod(
    start_month=python_3_script_9.start_month,
    start_day=python_3_script_9.start_day,
    start_hour=python_3_script_9.start_hour,
    end_month=python_3_script_9.end_month,
    end_day=python_3_script_9.end_day,
    end_hour=python_3_script_9.end_hour)  # -> period, hoys, dates; plug-in component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
decnstrloc_2 = LBDeconstructLocation(location=importepw_2.location)  # -> name, latitude, longitude, time_zone, elevation; plug-in component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
genpts_2 = LBGeneratePointGrid(geometry=flatten(geometry_2), grid_size=Slider(3, range=0..100))  # -> flatten(points), vectors, face_areas, mesh; plug-in component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
analysisperiod_2 = LBAnalysisPeriod(
    start_month=python_3_script_8.start_month,
    start_day=python_3_script_8.start_day,
    start_hour=python_3_script_8.start_hour,
    end_month=python_3_script_8.end_month,
    end_day=python_3_script_8.end_day,
    end_hour=python_3_script_8.end_hour)  # -> period, hoys, dates; plug-in component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
location_name = Data(decnstrloc.name)
panel_55 = Panel(analysisperiod.period)
location_name_2 = Data(decnstrloc_2.name)
applyper = LBApplyAnalysisPeriod(data=importepw.horizontal_infrared_rad, period=analysisperiod.period)  # -> data; plug-in component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
applyper_2 = LBApplyAnalysisPeriod(data=importepw.dry_bulb_temperature, period=analysisperiod.period)  # -> data; plug-in component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
applyper_3 = LBApplyAnalysisPeriod(data=importepw.relative_humidity, period=analysisperiod.period)  # -> data; plug-in component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
applyper_4 = LBApplyAnalysisPeriod(data=importepw.wind_speed, period=analysisperiod.period)  # -> data; plug-in component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
applyper_5 = LBApplyAnalysisPeriod(data=importepw.direct_normal_rad, period=analysisperiod.period)  # -> data; plug-in component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
applyper_6 = LBApplyAnalysisPeriod(data=importepw.diffuse_horizontal_rad, period=analysisperiod.period)  # -> data; plug-in component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
applyper_7 = LBApplyAnalysisPeriod(data=importepw_2.dry_bulb_temperature, period=analysisperiod_2.period)  # -> data; plug-in component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
applyper_8 = LBApplyAnalysisPeriod(data=importepw_2.relative_humidity, period=analysisperiod_2.period)  # -> data; plug-in component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
applyper_9 = LBApplyAnalysisPeriod(data=importepw_2.horizontal_infrared_rad, period=analysisperiod_2.period)  # -> data; plug-in component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
applyper_10 = LBApplyAnalysisPeriod(data=importepw_2.wind_speed, period=analysisperiod_2.period)  # -> data; plug-in component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
applyper_11 = LBApplyAnalysisPeriod(data=importepw_2.direct_normal_rad, period=analysisperiod_2.period)  # -> data; plug-in component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
applyper_12 = LBApplyAnalysisPeriod(data=importepw_2.diffuse_horizontal_rad, period=analysisperiod_2.period)  # -> data; plug-in component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
humantosky = LBHumanToSkyRelation(location=importepw.location, position=flatten(genpts.points), context=flatten(merge_3), run=Toggle(True))  # -> report, human_points, human_line, fract_body_exp, sky_exposure; plug-in component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
humantosky_2 = LBHumanToSkyRelation(location=importepw_2.location, position=flatten(genpts_2.points), context=flatten(merge_4), run=Toggle(True))  # -> report, human_points, human_line, fract_body_exp, sky_exposure; plug-in component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
outdoorsolarmrt = LBOutdoorSolarMRT(
    location=importepw.location,
    surface_temp=applyper_2,
    dir_norm_rad=applyper_5,
    diff_horiz_rad=applyper_6,
    horiz_infrared=applyper,
    sky_exposure=humantosky.sky_exposure,
    ground_ref=0.5,
    run=Toggle(True))  # -> report, short_erf, long_erf, short_dmrt, long_dmrt, mrt; plug-in component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
outdoorsolarmrt_2 = LBOutdoorSolarMRT(
    location=importepw_2.location,
    surface_temp=applyper_7,
    dir_norm_rad=applyper_11,
    diff_horiz_rad=applyper_12,
    horiz_infrared=applyper_9,
    sky_exposure=humantosky_2.sky_exposure,
    ground_ref=0.5,
    run=Toggle(True))  # -> report, short_erf, long_erf, short_dmrt, long_dmrt, mrt; plug-in component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
list_length_4 = ListLength(List=outdoorsolarmrt.mrt)
list_length_5 = ListLength(List=outdoorsolarmrt_2.mrt)
repeat_data = RepeatData(Data=applyper_3, Length=list_length_4)
repeat_data_2 = RepeatData(Data=applyper_2, Length=list_length_4)
repeat_data_3 = RepeatData(Data=applyper_4, Length=list_length_4)
repeat_data_4 = RepeatData(Data=applyper_8, Length=list_length_5)
repeat_data_5 = RepeatData(Data=applyper_7, Length=list_length_5)
repeat_data_6 = RepeatData(Data=applyper_10, Length=list_length_5)
number_slider_12 = Slider(1, range=0..10)
comfortable = ColourSwatch(SwatchColor=RGB(255, 0, 0))
uncomfortable = ColourSwatch(SwatchColor=RGB(0, 0, 255))
utci = LBUTCIComfort(air_temp=repeat_data_2, mrt=outdoorsolarmrt.mrt, rel_humid=repeat_data, wind_vel=repeat_data_3, run=Toggle(True))  # -> report, utci, comfort, condition, category, comf_obj; plug-in component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
comfortable_2 = ColourSwatch(SwatchColor=RGB(255, 0, 0))
uncomfortable_2 = ColourSwatch(SwatchColor=RGB(0, 0, 255))
number_slider_13 = Slider(1, range=0..10)
colrange = LBColorRange(index=Slider(0, range=0..100))  # -> colors; plug-in component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
merge_5 = Merge(Data1=comfortable, Data2=uncomfortable)
utci_2 = LBUTCIComfort(air_temp=repeat_data_5, mrt=outdoorsolarmrt_2.mrt, rel_humid=repeat_data_4, wind_vel=repeat_data_6, run=Toggle(True))  # -> report, utci, comfort, condition, category, comf_obj; plug-in component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
merge_6 = Merge(Data1=comfortable_2, Data2=uncomfortable_2)
lng = ListLength(List=merge_5)
colrange_2 = LBColorRange(index=Slider(0, range=0..100))  # -> colors; plug-in component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
xdata = LBDeconstructData(data=utci.utci)  # -> header, flatten(values); plug-in component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
bounds = Bounds(Numbers=xdata.values)
xdata_2 = LBDeconstructData(data=utci.comfort)  # -> header, flatten(values); plug-in component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
xdata_3 = LBDeconstructData(data=utci.condition)  # -> header, flatten(values); plug-in component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
lng_2 = ListLength(List=merge_6)
deconstruct_domain = DeconstructDomain(Domain=bounds)  # -> Start, End
xdata_4 = LBDeconstructData(data=utci_2.utci)  # -> header, flatten(values); plug-in component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
bounds_2 = Bounds(Numbers=xdata_4.values)
deconstruct_domain_2 = DeconstructDomain(Domain=bounds_2)  # -> Start, End
xdata_5 = LBDeconstructData(data=utci_2.comfort)  # -> header, flatten(values); plug-in component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
xdata_6 = LBDeconstructData(data=utci_2.condition)  # -> header, flatten(values); plug-in component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
item_3 = ListItem(List=xdata.header, Index=0, Wrap=True)
legendpar = LBLegendParameters(
    min="0",
    max="1",
    seg_count=lng,
    colors=merge_5,
    continuous_leg=Toggle(False),
    num_decimals="0",
    text_height=number_slider_12)  # -> leg_par; plug-in component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
item_4 = ListItem(List=xdata_2.header, Index=0, Wrap=True)
item_5 = ListItem(List=xdata_3.header, Index=0, Wrap=True)
round = Round(Number=deconstruct_domain_2.Start)  # -> Nearest, Floor, Ceiling
round_2 = Round(Number=deconstruct_domain_2.End)  # -> Nearest, Floor, Ceiling
legendpar_2 = LBLegendParameters(min=round.Floor, max=round_2.Ceiling, colors=colrange_2, num_decimals=2, text_height=number_slider_13)  # -> leg_par; plug-in component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
legendpar_3 = LBLegendParameters(
    min="0",
    max="1",
    seg_count=lng_2,
    colors=merge_6,
    continuous_leg=Toggle(False),
    num_decimals="0",
    text_height=number_slider_13)  # -> leg_par; plug-in component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
round_3 = Round(Number=deconstruct_domain.Start)  # -> Nearest, Floor, Ceiling
round_4 = Round(Number=deconstruct_domain.End)  # -> Nearest, Floor, Ceiling
legendpar_4 = LBLegendParameters(min=round_3.Floor, max=round_4.Ceiling, colors=colrange, num_decimals=2, text_height=number_slider_12)  # -> leg_par; plug-in component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
item_6 = ListItem(List=xdata_4.header, Index=0, Wrap=True)
item_7 = ListItem(List=xdata_5.header, Index=0, Wrap=True)
item_8 = ListItem(List=xdata_6.header, Index=0, Wrap=True)
heatmap = LBSpatialHeatmap(values=xdata.values, mesh=genpts.mesh, legend_par=legendpar_4, legend_title="UTCI, °C", global_title=item_3)  # -> out, mesh, legend, title, colors, legend_par, vis_set; plug-in component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
heatmap_2 = LBSpatialHeatmap(values=xdata_4.values, mesh=genpts_2.mesh, legend_par=legendpar_2, legend_title="UTCI, °C", global_title=item_6)  # -> out, mesh, legend, title, colors, legend_par, vis_set; plug-in component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
utci_values_without_trees = Data(xdata.values)
utci_values_with_trees = Data(xdata_4.values)
python_3_script_10 = Python3Script(utci_values=utci_values_with_trees, utci_values_flat=utci_values_without_trees)  # -> out, a; inputs utci_values: list
# ---------- python_3_script_10: Python ----------
# requirements: requests

import requests
import json

def send_utci_to_ui(utci_values, utci_values_flat):
    """
    Send two sets of UTCI values to the server for comparison:
        1. utci_values: UTCI values with trees (better thermal comfort)
        2. utci_values_flat: UTCI values without trees (baseline)

    Returns:
        success: Boolean
        message: Status message
    """
    try:
        print(f"📤 Sending UTCI comparison data")
        print(f"   With trees: {utci_values}")
        print(f"   Without trees: {utci_values_flat}")
        
        # ✅ Correct data structure that matches server expectations
        data = {
            "utci_values": utci_values,  # Values with trees
            "utci_values_flat": utci_values_flat  # Values without trees
        }

        response = requests.post(
            "http://127.0.0.1:5000/utci_values",
            json=data,
            headers={'Content-Type': 'application/json'},
            timeout=10
        )

        print(f"   Response status: {response.status_code}")
        print(f"   Response content: {response.text}")

        if response.status_code == 200:
            result = response.json()
            print("✅ UTCI comparison data sent successfully!")
            return True, "UTCI comparison data sent successfully"
        else:
            print("❌ Server returned an error")
            return False, f"Server error: {response.status_code}"

    except Exception as e:
        print(f"❌ Error sending UTCI comparison data: {e}")
        return False, str(e)


def flatten(input_list):
    """Recursively flattens nested lists/tuples"""
    for item in input_list:
        if isinstance(item, (list, tuple)):
            yield from flatten(item)
        else:
            yield item


def process_utci_list(utci_input):
    """
    Clean and convert UTCI inputs to floats.
    Handles flat and nested lists.
    """
    print(f"🔍 Processing input of type {type(utci_input)}")
    clean_utci_values = []

    try:
        # Handle different input types
        if isinstance(utci_input, (list, tuple)):
            flattened = list(flatten(utci_input))
        elif isinstance(utci_input, str):
            # If it's a single string, try to convert it to float
            flattened = [utci_input]
        else:
            # Single value
            flattened = [utci_input]
    except Exception as e:
        print(f"❌ Error processing input: {e}")
        return []

    for i, val in enumerate(flattened):
        try:
            clean_val = float(val)
            clean_utci_values.append(clean_val)
            print(f"   ✓ Value {i+1}: {clean_val:.2f}°C")
        except (ValueError, TypeError) as e:
            print(f"   ⚠️ Skipping value {i+1}: '{val}' (error: {e})")

    return clean_utci_values


# --- Grasshopper inputs ---
# Replace these with actual GH inputs: utci_values and utci_values_flat
# Make sure you FLATTEN the second input (`utci_values_flat`) in GH if needed

print("🔄 Processing UTCI values for comparison...")

# Process both sets of UTCI values
all_utci_values_tree = process_utci_list(utci_values)  # With trees
all_utci_values_flat = process_utci_list(utci_values_flat)  # Without trees

if all_utci_values_tree or all_utci_values_flat:
    print(f"\n🚀 Ready to send comparison data:")
    print(f"   With trees: {len(all_utci_values_tree)} values")
    print(f"   Without trees: {len(all_utci_values_flat)} values")
    
    success, message = send_utci_to_ui(all_utci_values_tree, all_utci_values_flat)
else:
    success = False
    message = "No valid UTCI values to send"
    print("❌ No valid UTCI values found")

# Grasshopper outputs
a = success
b = message
c = len(all_utci_values_tree)
d = len(all_utci_values_flat)

print(f"\nFinal Status: {message}")
print(f"Values with trees: {c}")
print(f"Values without trees: {d}")

# Additional info for debugging
if success:
    print("✅ Data sent successfully! The UI will now show:")
    print("   - Comparison between tree and flat values")
    print("   - Average improvement from trees")
    print("   - Tips for further optimization")
else:
    print("❌ Failed to send data. Check the error message above.")
# ---------- end python_3_script_10 ----------

panel_56 = Panel(genpts_2.points)
panel_57 = Panel(xdata_4.values)
concatenate_12 = Concatenate(Fragment_A="(", Fragment_B=panel_56, A=", ", B=panel_57, C=")")
panel_58 = Panel(concatenate_12)
python_3_script_11 = Python3Script(heatmap_data=concatenate_12)  # -> out, a; inputs heatmap_data: list
# ---------- python_3_script_11: Python ----------
# requirements: requests
"""
Minimal script for Grasshopper to send heatmap data to the server.
Grasshopper only needs this function - the analysis and recommendations are handled by the server/UI.
"""

import requests
import json

def send_heatmap_data_to_server(heatmap_data):
    """
    Send heatmap data from Grasshopper to the server for analysis.
    
    Args:
        heatmap_data (list): List of coordinate and UTCI value pairs
            Supports multiple formats:
            - [({x, y, z}, utci_value), ...] - Set format
            - [([x, y, z], utci_value), ...] - List format  
            - [((x, y, z), utci_value), ...] - Tuple format
            - [[x, y, z, utci_value], ...] - Flat list format
            - ["({x, y, z}, utci_value)", ...] - String format from Grasshopper
            Note: z-coordinate will be ignored for 2D analysis
    
    Returns:
        dict: Server response with analysis results
    """
    try:
        # Debug: Print the actual data structure
        print(f"DEBUG: heatmap_data type: {type(heatmap_data)}")
        print(f"DEBUG: heatmap_data length: {len(heatmap_data)}")
        if heatmap_data:
            print(f"DEBUG: First item type: {type(heatmap_data[0])}")
            print(f"DEBUG: First item: {heatmap_data[0]}")
            if len(heatmap_data) > 1:
                print(f"DEBUG: Second item: {heatmap_data[1]}")
        
        # Convert 3D coordinates to 2D for analysis (ignore z-coordinate)
        heatmap_2d = []
        
        for i, point in enumerate(heatmap_data):
            try:
                # Handle string format from Grasshopper
                if isinstance(point, str):
                    # Parse string like "({-25.158039, 26.376091, 0}, 21.393704)"
                    point = point.strip()
                    if point.startswith("(") and point.endswith(")"):
                        # Remove outer parentheses
                        point = point[1:-1]
                        
                        # Split by the comma that separates coordinates from UTCI
                        # Find the last comma that's not inside the set
                        last_comma_idx = point.rfind(",")
                        if last_comma_idx != -1:
                            coord_str = point[:last_comma_idx].strip()
                            utci_str = point[last_comma_idx + 1:].strip()
                            
                            # Parse coordinates (set format: {x, y, z})
                            if coord_str.startswith("{") and coord_str.endswith("}"):
                                coord_str = coord_str[1:-1]  # Remove { }
                                coord_parts = [part.strip() for part in coord_str.split(",")]
                                if len(coord_parts) >= 2:
                                    x = float(coord_parts[0])
                                    y = float(coord_parts[1])
                                    utci_value = float(utci_str)
                                    coord_2d = [x, y]
                                    heatmap_2d.append([coord_2d, utci_value])
                                    continue
                
                # Handle different data formats (non-string)
                if isinstance(point, (list, tuple)):
                    if len(point) == 2:
                        # Format: ([x, y, z], utci) or ((x, y, z), utci)
                        coord, utci_value = point
                        
                        if isinstance(coord, set):
                            # Set format: {x, y, z}
                            coord_list = list(coord)
                            if len(coord_list) >= 2:
                                coord_2d = [float(coord_list[0]), float(coord_list[1])]
                                heatmap_2d.append([coord_2d, float(utci_value)])
                        elif isinstance(coord, (list, tuple)):
                            # List/Tuple format: [x, y, z] or (x, y, z)
                            if len(coord) >= 2:
                                coord_2d = [float(coord[0]), float(coord[1])]
                                heatmap_2d.append([coord_2d, float(utci_value)])
                    elif len(point) == 4:
                        # Flat format: [x, y, z, utci]
                        coord_2d = [float(point[0]), float(point[1])]
                        heatmap_2d.append([coord_2d, float(point[3])])
                    elif len(point) == 3:
                        # Format: [x, y, utci] (already 2D)
                        coord_2d = [float(point[0]), float(point[1])]
                        heatmap_2d.append([coord_2d, float(point[2])])
                        
                elif isinstance(point, dict):
                    # Dictionary format: {"x": x, "y": y, "z": z, "utci": utci}
                    if "x" in point and "y" in point and "utci" in point:
                        coord_2d = [float(point["x"]), float(point["y"])]
                        heatmap_2d.append([coord_2d, float(point["utci"])])
                        
            except Exception as e:
                print(f"DEBUG: Error processing point {i}: {point}")
                print(f"DEBUG: Error details: {e}")
                continue
        
        # Prepare the request data
        request_data = {
            "heatmap_data": heatmap_2d
        }
        
        headers = {'Content-Type': 'application/json'}
        
        print(f"Original data points: {len(heatmap_data)}")
        print(f"Converted to 2D: {len(heatmap_2d)} points")
        print(f"Sample point: {heatmap_2d[0] if heatmap_2d else 'No data'}")
        
        if not heatmap_2d:
            print("❌ No valid data points found after conversion!")
            print("Please check your data format. Expected formats:")
            print("- [({x, y, z}, utci_value), ...]")
            print("- [([x, y, z], utci_value), ...]")
            print("- [[x, y, z, utci_value], ...]")
            print("- [{'x': x, 'y': y, 'z': z, 'utci': utci}, ...]")
            print("- [\"({x, y, z}, utci_value)\", ...] (string format from Grasshopper)")
            return None
            
        print(f"Sending request to: http://127.0.0.1:5000/heatmap_analysis")
        
        response = requests.post(
            "http://127.0.0.1:5000/heatmap_analysis",
            json=request_data,
            headers=headers,
            timeout=60  # Longer timeout for analysis
        )
        
        print(f"Response status: {response.status_code}")
        
        if response.status_code == 200:
            result = response.json()
            print("✅ Heatmap analysis completed successfully!")
            print(f"Analysis result: {result}")
            return result
        else:
            print(f"❌ Server error: {response.status_code}")
            print(f"Response: {response.text}")
            return None
            
    except Exception as e:
        print(f"❌ Error sending heatmap data: {e}")
        print(f"Error type: {type(e)}")
        import traceback
        traceback.print_exc()
        return None

# Test function to verify the connection
def test_connection():
    """Test if the server is running and accessible"""
    try:
        response = requests.get("http://127.0.0.1:5000/", timeout=5)
        print(f"✅ Server is running! Status: {response.status_code}")
        return True
    except requests.exceptions.ConnectionError:
        print("❌ Cannot connect to server. Make sure the Flask server is running on port 5000")
        return False
    except Exception as e:
        print(f"❌ Connection test failed: {e}")
        return False

if heatmap_data:
    send_heatmap_data_to_server(heatmap_data)
# ---------- end python_3_script_11 ----------
